# Grasshopper definition temp.gh (Grasshopper 1.0.7)
# plug-ins: Axolotl Info

read_file = ReadFile(File="C:\Zac\19 Github\ZacZhangzhuo.github.io\tools\zAddItems.py", PerLineParse=False)
twist = Twist(Angle=0, Plane=PlaneXY(0, 0, 0))
box = Box(DimensionX=8, DimensionY=7, DimensionZ=6, Radius=0, Plane=PlaneXY(0, 0, 0))
array_limited = ArrayLimited(CellsizeX=1, CellsizeY=1, CellsizeZ=1, NumberX=2, NumberY=2, NumberZ=2)
ghpython_script = GhPythonScript(Code=read_file)  # -> Out, A
panel = Panel(ghpython_script.Out)
